# Grasshopper definition HoneyComb.gh (Grasshopper 1.0.7)
# plug-ins: LunchBox, Pufferfish

# ---- group: Hexagonal
crv = Curve(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)
boundary = BoundarySurfaces(Edges=crv)
hex = HexagonCells(Surface=boundary, UDivisions=Slider(12, range=0..20), VDivisions=Slider(8, range=0..20), TParameter=0.25)  # -> HexagonCells, Centers
scale = Scale(Geometry=hex.HexagonCells, Center=hex.Centers, Factor=Slider(0.8, range=0..1))  # -> Geometry, Transform
rdiff = RegionDifference(CurvesA=boundary, CurvesB=scale.Geometry)
Z = UnitZ(Factor=Slider(25, range=0..100))
boundary_2 = BoundarySurfaces(Edges=rdiff)
extr = Extrude(Base=boundary_2, Direction=Z)
preview = CustomPreview(
    Geometry=extr,
    Material={diffuse=RGB(221, 160, 221), emission=RGB(66, 48, 66), shine=0.5, specular=RGB(255, 255, 255), transparency=0})

# ---- group: Rombic
crv_2 = Curve(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)
boundary_3 = BoundarySurfaces(Edges=crv_2)
wall_thickness = Slider(1, range=0..1)
diamond = DiamondPanels(Surface=boundary_3, UDivisions=Slider(11, range=0..20), VDivisions=Slider(10, range=0..20))  # -> DiamondPanels, TriPanels
area = Area(Geometry=diamond.TriPanels)  # -> Area, Centroid
area_2 = Area(Geometry=diamond.DiamondPanels)  # -> Area, Centroid
scale_2 = Scale(Geometry=diamond.TriPanels, Center=area.Centroid, Factor=wall_thickness)  # -> Geometry, Transform
scale_3 = Scale(Geometry=diamond.DiamondPanels, Center=area_2.Centroid, Factor=Slider(0.7, range=0..1))  # -> Geometry, Transform
rdiff_2 = RegionDifference(CurvesA=boundary_3, CurvesB=[scale_2.Geometry, scale_3.Geometry])
Z_2 = UnitZ(Factor=Slider(25, range=0..100))
boundary_4 = BoundarySurfaces(Edges=rdiff_2)
extr_2 = Extrude(Base=boundary_4, Direction=Z_2)
preview_2 = CustomPreview(
    Geometry=extr_2,
    Material={diffuse=RGB(221, 160, 221), emission=RGB(66, 48, 66), shine=0.5, specular=RGB(255, 255, 255), transparency=0})

# ---- group: Triangelar Walled
crv_3 = Curve(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)
boundary_5 = BoundarySurfaces(Edges=crv_3)
wall_thickness_2 = Slider(1, range=0..1)
trib = TrianglePanelsB(Surface=boundary_5, UDivisions=Slider(8, range=0..20), VDivisions=Slider(8, range=0..20))
area_3 = Area()  # -> Area, Centroid
area_4 = Area(Geometry=trib)  # -> Area, Centroid
scale_4 = Scale(Center=area_3.Centroid, Factor=wall_thickness_2)  # -> Geometry, Transform
scale_5 = Scale(Geometry=trib, Center=area_4.Centroid, Factor=Slider(0.7, range=0..1))  # -> Geometry, Transform
rdiff_3 = RegionDifference(CurvesA=boundary_5, CurvesB=[scale_4.Geometry, scale_5.Geometry])
Z_3 = UnitZ(Factor=Slider(25, range=0..100))
boundary_6 = BoundarySurfaces(Edges=rdiff_3)
extr_3 = Extrude(Base=boundary_6, Direction=Z_3)
preview_3 = CustomPreview(
    Geometry=extr_3,
    Material={diffuse=RGB(221, 160, 221), emission=RGB(66, 48, 66), shine=0.5, specular=RGB(255, 255, 255), transparency=0})

# ----
number_slider = Slider(5, range=0..10)
crv_4 = Curve(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)
boundary_7 = BoundarySurfaces(Edges=crv_4)
crv_5 = Curve(<curve referenced from the Rhino model>)
dgrid = DiamondGrid(Surface=boundary_7, UDivisions=number_slider, VDivisions=number_slider)  # -> CornerPoint1, CornerPoint2, CornerPoint3, CornerPoint4, MidPoint, Normals
area_5 = Area(Geometry=crv_5)  # -> Area, Centroid
move2pt = MoveToPoint(
    Geometry=crv_5,
    PointA=area_5.Centroid,
    PointB=[dgrid.MidPoint, dgrid.CornerPoint2, dgrid.CornerPoint3, dgrid.CornerPoint4])  # -> Moved, Vector, Transform
incurve = PointInCurve(Point=[dgrid.CornerPoint2, dgrid.CornerPoint1, dgrid.CornerPoint3, dgrid.CornerPoint4, dgrid.MidPoint], Curve=crv_4)  # -> Relationship, Point
area_6 = Area(Geometry=boundary_6)  # -> Area, Centroid
panel = Panel(area_6.Area)
