# Grasshopper definition PCB_traces_gnerator.gh (Grasshopper 1.0.7)
# plug-ins: Bifocals

number_slider = Slider(5.922, range=0..10)
crv = Curve([<curve referenced from the Rhino model> x2])
neg = Negative(Value=number_slider)
offset = OffsetCurve(Curve=graft(crv), Distance=[number_slider, neg], Corners=1)  # -> flatten(Curve)
number_slider_2 = Slider(2, range=0..10)
lng = ListLength(List=offset)
division = Division(A=lng, B=number_slider_2)
series = Series(Start=number_slider_2, Step=Slider(0, range=0..100), Count=division)
partition = PartitionList(List=offset, Size=series)
panel = Panel(partition)
curvepoint = PointOnCurve(partition, parameter=1)
curvepoint_2 = PointOnCurve(partition, parameter=0)
item = ListItem(List=curvepoint, Index=0, Wrap=True)  # -> Item, Item1
item_2 = ListItem(List=curvepoint_2, Index=0, Wrap=True)  # -> Item, Item1
ln = Line(StartPoint=item_2.Item, EndPoint=item_2.Item1)
ln_2 = Line(StartPoint=item.Item, EndPoint=item.Item1)
multiplication = Multiplication(A=number_slider, B="3")
division_2 = Division(A=multiplication, B="2")
number_slider_3 = Slider(3, range=0..10)
curvepoint_3 = PointOnCurve(ln, parameter=0.5)
join = JoinCurves(Curves=[ln, partition, ln_2], Preserve=False)
curvepoint_4 = PointOnCurve(ln_2, parameter=0.5)
cir = Circle(Plane=[curvepoint_3, curvepoint_4], Radius=multiplication)
cir_2 = Circle(Plane=[curvepoint_3, curvepoint_4], Radius=division_2)
runion = RegionUnion(Curves=flatten([cir, join]))
panel_2 = Panel(runion)
