# Grasshopper definition traceGen.gh (Grasshopper 1.0.7)

number_slider = Slider(0.025, range=0.01..1.01)
crv = Curve([<curve referenced from the Rhino model> x2])
neg = Negative(Value=number_slider)
offset = OffsetCurve(Curve=graft(crv), Distance=[number_slider, neg], Corners=1)
