# Grasshopper definition RobotGenerator.gh (Grasshopper 1.0.7)
# plug-ins: Pufferfish

brep = Brep(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)
crv = Curve([<curve referenced from the Rhino model> x4])
merge = Merge(Data1=brep, Data2=crv)  # -> graft(Result)
xz = XZPlane(Origin=Point(0, 0, 0))
Y = UnitY(Factor=Slider(122, range=1..151))
mirror = Mirror(Geometry=merge, Plane=xz)  # -> Geometry, Transform
series = Series(Start=0, Step=Slider(122, range=0..200), Count=Slider(2, range=1..2))
crv_2 = Curve([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])
X = UnitX(Factor=Slider(0, range=0..180))
move = Move(Geometry=mirror.Geometry, Motion=Y)  # -> Geometry, Transform
X_2 = UnitX(Factor=series)
rectangle = Rectangle(Plane=PlaneXY(0, 0, 0), XSize=Domain(-1, 1), YSize=Domain(-2, 2), Radius=0)  # -> Rectangle, Length
move_2 = Move(Geometry=crv_2, Motion=X)  # -> Geometry, Transform
merge_2 = Merge(Data1=brep, Data2=move.Geometry)
move_3 = Move(Geometry=merge_2, Motion=X_2)  # -> Geometry, Transform
python = GhPythonScript(x=move_3.Geometry)  # -> out, a; inputs x: tree
# ---------- python: Python ----------
import Rhino.Geometry as rg
import ghpythonlib.treehelpers as th
 
lst = th.tree_to_list(x)

for objs in lst:
    for obj in objs:
        print(obj)
# ---------- end python ----------
panel = Panel(python.out)
brec = BoundingRectangle(Geometry=flatten(move_3.Geometry), Plane=PlaneXY(0, 0, 0), Axis=0, Slide=1, Union=True)  # -> Bounding, DimensionX, DimensionY
area = Area(Geometry=brec.Bounding)  # -> Area, Centroid
X_3 = UnitX(Factor=Slider(0, range=0..100))
scale_nu = ScaleNU(
    Geometry=brec.Bounding,
    Plane=area.Centroid,
    ScaleX=Slider(1.2, range=0.2..10),
    ScaleY=Slider(1, range=0.2..10),
    ScaleZ=1)  # -> Geometry, Transform
preview = CustomPreview(Geometry=move_3.Geometry, Material=ColourSwatch(SwatchColor=RGB(71, 212, 255)))
fillet = Fillet(Curve=scale_nu.Geometry, Radius=Slider(26, range=0..120))
move_4 = Move(Geometry=fillet, Motion=X_3)  # -> Geometry, Transform
merge_3 = Merge(Data1=move_2.Geometry, Data2=move_4.Geometry)
