# Grasshopper definition TireGenerator.gh (Grasshopper 1.0.7)

panel = Panel("""0
3
6
0
6
3
0""")
pt = Point(Point(0, 0, 0))
crv = Curve(<curve referenced from the Rhino model>)
disk_height = Slider(15, range=0..100)
number_slider = Slider(6, range=0..10)
dom = ConstructDomain(DomainStart=0, DomainEnd=disk_height)
arrpolar = PolarArray(Geometry=crv, Plane=pt, Count=Slider(24, range=0..100), Angle=6.283185307)  # -> Geometry, Transform
cir = Circle(Plane=pt, Radius=Slider(37, range=0..100))
range = Range(Domain=dom, Steps=number_slider)
Z = UnitZ(Factor=range)
runion = RegionUnion(Curves=flatten([cir, arrpolar.Geometry]))
cir_2 = Circle(Plane=pt, Radius=Slider(35.5, range=0..100))
Z_2 = UnitZ(Factor=disk_height)
move = Move(Geometry=cir_2, Motion=Z_2)  # -> Geometry, Transform
series = Series(Start=0, Step=Slider(3, range=0..30), Count=expr("x+1", number_slider))
move_2 = Move(Geometry=runion, Motion=Z)  # -> Geometry, Transform
curvepoint = PointOnCurve([move.Geometry, cir_2], parameter=0)
rotate = Rotate(Geometry=move_2.Geometry, Angle=degrees(panel), Plane=pt)  # -> Geometry, Transform
item = ListItem(List=curvepoint, Index=0, Wrap=True)  # -> Item, Item1
panel_2 = Panel(series)
lng = ListLength(List=rotate.Geometry)
ln = Line(StartPoint=item.Item, EndPoint=item.Item1)
curvepoint_2 = PointOnCurve(ln, parameter=0)
loft = Loft(Curves=rotate.Geometry, Options={Adjust=False, Closed=False, LoftEnds=0, LoftSimp=0, LoftType=0, Rebuild=10, Refit=0.01})
item_2 = ListItem(List=rotate.Geometry, Index=expr("x-1", lng), Wrap=True)
vec2pt = Vector2Pt(PointA=curvepoint_2, PointB=pt, Unitize=False)  # -> Vector, Length
boundary = BoundarySurfaces(Edges=flatten([move.Geometry, item_2]))
boundary_2 = BoundarySurfaces(Edges=flatten([cir_2, runion]))
amp = Amplitude(Vector=vec2pt.Vector, Amplitude=Slider(2.748, range=0..10))
move_3 = Move(Geometry=curvepoint_2, Motion=amp)  # -> Geometry, Transform
merge = Merge(Data1=item.Item1, Data2=move_3.Geometry, Data3=item.Item)
nurbs = NurbsCurve(Vertices=merge, Degree=2, Periodic=False)  # -> Curve, Length, Domain
swp1 = Sweep1(Rail=cir_2, Sections=nurbs.Curve, Miter=1)
join = BrepJoin(Breps=flatten([loft, boundary_2, boundary, swp1]))  # -> Breps, Closed
number_slider_2 = Slider(1.1, range=0..10)
preview = CustomPreview(Geometry=join.Breps, Material=ColourSwatch(SwatchColor=RGB(79, 53, 53)))
scale_nu = ScaleNU(Geometry=join.Breps, Plane=pt, ScaleX=number_slider_2, ScaleY=number_slider_2, ScaleZ=1)  # -> Geometry, Transform
