# Grasshopper definition gearsTest.gh (Grasshopper 1.0.7)
# plug-ins: Gear

pt = Point([Point(0, 0, 0), Point(0, 0, 9), Point(6, 0, 9)])
pline = PolyLine(Vertices=pt, Closed=False)
axepitch = Axe2Pitch(Axe=pline, Radius=Slider(15.2, range=0..100))  # -> PitchCircle, AxePolyline
bevelg = BevelGear(
    Circle=axepitch.PitchCircle,
    Polyline=axepitch.AxePolyline,
    Teeth=Slider(19, range=0..100),
    Depth=Slider(4, range=0..10),
    HoleSize=[Slider(2, range=0..10), Slider(2, range=0..10)],
    Angle=22.5,
    Shift=0.1,
    Addendum=0.95,
    Dedendum=1.25,
    Option=Slider(0, range=0..2))  # -> Gears, Pitch, Ratio
geo = Geometry(bevelg.Gears)
