# Grasshopper definition Joystick_multipipe.gh (Grasshopper 1.0.7)
# plug-ins: Kangaroo2 Components

crv = Curve([<curve referenced from the Rhino model> x16])
subd = SubD(<subd referenced from the Rhino model>)
subdedges = SubDEdges(SubD=subd, NewFormatting=False)  # -> Line, Edge, Tag, Id
mp = MultiPipe(
    Curves=flatten(crv),
    NodeSize=Slider(1.554, range=0..30),
    EndOffset=1,
    StrutSize=1,
    Segment=0,
    KinkAngle=0.6,
    CubeFit=0,
    Caps=0)
crv_2 = Curve(subdedges.Edge)
crv_3 = Curve([<curve referenced from the Rhino model> x106])
Y = UnitY(Factor=Slider(100, range=0..100))
preview = CustomPreview(
    Geometry=mp,
    Material={diffuse=RGB(221, 160, 221), emission=RGB(66, 48, 66), shine=0.5, specular=RGB(255, 255, 255), transparency=0})
move = Move(Geometry=crv_2, Motion=Y)  # -> Geometry, Transform
mp_2 = MultiPipe(
    Curves=flatten(move.Geometry),
    NodeSize=Slider(2.18, range=0..10),
    EndOffset=1,
    StrutSize=Slider(0.544, range=0..10),
    Segment=0,
    KinkAngle=0.6,
    CubeFit=0,
    Caps=0)
preview_2 = CustomPreview(
    Geometry=mp_2,
    Material={diffuse=RGB(221, 160, 221), emission=RGB(66, 48, 66), shine=0.5, specular=RGB(255, 255, 255), transparency=0})
series = Series(Start=Slider(0.4, range=0..1), Step=Slider(0.7, range=0..1), Count=Slider(17, range=0..170))

rotation = Slider(0, range=0..80)
line = LineSDL(Start=Point(0, 0, 0), Direction=Vector(0, 0, 1), Length=Slider(60, range=0..100))
number_slider = Slider(5, range=0..10)
area = Slider(46.5, range=0..100)
range = Range(Domain=Domain(0, 1), Steps=number_slider)
graph = GraphMapper(
    range,
    x0=0,
    x1=1,
    y0=0,
    y1=1,
    container_name="Sinc",
    Equation_X0=0.5251613259,
    Equation_X1=0.2614203095,
    Equation_Y0=0.2440340519,
    Equation_Y1=0.7106537819)
divide = DivideCurve(Curve=line, Count=number_slider, Kinks=False)  # -> Points, Tangents, Parameters
multiplication = Multiplication(A=area, B=graph)
series_2 = Series(Start=0, Step=rotation, Count=number_slider)
cir = Circle(Plane=divide.Points, Radius=multiplication)
rotate = Rotate(Geometry=cir, Angle=degrees(series_2), Plane=PlaneXY(0, 0, 0))  # -> Geometry, Transform
divide_2 = DivideCurve(Curve=rotate.Geometry, Count=number_slider, Kinks=False)  # -> simplify(Points), Tangents, Parameters
flip = FlipMatrix(Data=divide_2.Points)
item = ListItem(List=flatten(flip), Index=number_slider, Wrap=True)
pdecon = Deconstruct(Point=item)  # -> XComponent, YComponent, ZComponent
replace = ReplaceItems(List=flip, Item="{0,0,0}", Indices="0", Wrap=False)
expression = Expression(z=pdecon.ZComponent, Expression="{0, 0, z}")
replace_2 = ReplaceItems(List=flip, Item=expression, Indices=number_slider, Wrap=False)
intcrv = Interpolate(Vertices=replace_2, Degree=3, Periodic=False, KnotStyle=1)  # -> Curve, Length, Domain

item_2 = ListItem(List=cir, Index=0, Wrap=True)

# ---- group: Open Ends
lng = ListLength(List=cir)
item_3 = ListItem(List=cir, Index=0, Wrap=True)
item_4 = ListItem(List=cir, Index=expr("x-1", lng), Wrap=True)
merge = Merge(Data1=item_3, Data2=intcrv.Curve, Data3=item_4)  # -> simplify(Result)

# ----
mp_3 = MultiPipe(
    Curves=flatten([intcrv.Curve, item_2]),
    NodeSize=Slider(2.4, range=0..10),
    EndOffset=Slider(3, range=0..10),
    StrutSize=1,
    Segment=0,
    KinkAngle=0.6,
    CubeFit=0,
    Caps=1)
preview_3 = CustomPreview(
    Geometry=mp_3,
    Material={diffuse=RGB(221, 160, 221), emission=RGB(66, 48, 66), shine=0.5, specular=RGB(255, 255, 255), transparency=0})
