# Grasshopper definition pattern-generator.gh (Grasshopper 1.0.7)
# plug-ins: LunchBox, Pufferfish

list = ValueList({"Straight": 1, "Bowling Pin": 2, "Brackets": 3, "Cross": 4}, selected="Cross")
crv = Curve(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)
crv_2 = Curve(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)
crv_3 = Curve(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)
crv_4 = Curve(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)
width = Slider(100, range=0..100)
width_2 = Slider(30, range=0..100)
python = GhPythonScript(crv=list, straight=crv, bowling=crv_2, bracket=crv_3, cross=crv_4)  # -> out, a; inputs crv: Int32, straight: Curve, bowling: Curve, bracket: Curve, cross: Curve
# ---------- python: Python ----------
if crv == 1:
    a = straight
elif crv == 2:
    a = bowling
elif crv == 3:
    a = bracket
elif crv == 4:
    a = cross
# ---------- end python ----------
dom = ConstructDomain(DomainStart=0, DomainEnd=width_2)
dom_2 = ConstructDomain(DomainStart=0, DomainEnd=width)
crv_5 = Curve(python.a)
rectangle = Rectangle(Plane=PlaneXY(0, 0, 0), XSize=dom, YSize=dom_2, Radius=0)  # -> Rectangle, Length
boundary = BoundarySurfaces(Edges=rectangle.Rectangle)
number_slider = Slider(3, range=0..10)
dgrid = DiamondGrid(Surface=boundary, UDivisions=Slider(9, range=0..100), VDivisions=Slider(127, range=0..200))  # -> CornerPoint1, CornerPoint2, CornerPoint3, CornerPoint4, MidPoint, Normals
area = Area(Geometry=crv_5)  # -> Area, Centroid
pt = Point(dgrid.MidPoint)
amp = Amplitude(Vector="{-1,0,0}", Amplitude=number_slider)
amp_2 = Amplitude(Vector="{1,0,0}", Amplitude=number_slider)
scale_nu = ScaleNU(Geometry=crv_5, Plane=area.Centroid, ScaleX=Slider(0.42, range=0..2), ScaleY=Slider(0.36, range=0..2), ScaleZ=1)  # -> Geometry, Transform
move = Move(Geometry=pt, Motion=amp)  # -> Geometry, Transform
move_2 = Move(Geometry=pt, Motion=amp_2)  # -> Geometry, Transform
move2pt = MoveToPoint(Geometry=scale_nu.Geometry, PointA=area.Centroid, PointB=pt)  # -> Moved, Vector, Transform
ln = Line(StartPoint=move.Geometry, EndPoint=move_2.Geometry)
item = ListItem(List=move.Geometry, Index=0, Wrap=True)
number_slider_2 = Slider(2, range=0..2)
offcrv = OffsetCurve(
    Curve=ln,
    Plane=PlaneXY(0, 0, 0),
    Distance=Slider(0.82, range=0..10),
    BothSides="1",
    Kinks=number_slider_2,
    CapType=number_slider_2)
trim = TrimWithRegion(Curve=move2pt.Moved, Region=rectangle.Rectangle)  # -> Inside, Outside
crv_6 = Curve(trim.Inside)
