# Grasshopper definition pattern-generator.gh (Grasshopper 1.0.7)

width = Slider(100, range=0..100)
width_2 = Slider(30, range=0..100)
dom = ConstructDomain(DomainStart=0, DomainEnd=width)
dom_2 = ConstructDomain(DomainStart=0, DomainEnd=width_2)
rectangle = Rectangle(Plane=PlaneXY(0, 0, 0), XSize=dom_2, YSize=dom, Radius=0)  # -> Rectangle, Length
