# Grasshopper definition BladeDesign.gh (Grasshopper 1.0.7)
# plug-ins: Pufferfish

leading_edge_length = Slider(53, range=0..80)
num_of_section_crvs = Slider(10, range=0..60)
margin_from_center = Slider(7, range=0..10)
camber_symmetry = Slider(15, range=0..30)
dist_b_section_crvs = Slider(9, range=0..60)
num_of_blades = Slider(4, range=0..10)
scale_x_mult = Slider(0.863, range=0..3)
scale_y_mult = Slider(0.988, range=0..3)
blade_angle = Slider(20, range=0..180)
blade_twist = Slider(0, range=0..180)
cylinder_radius = Slider(11, range=0..100)
cylinder_length = Slider(4, range=0..10)
shaft_radius = Slider(3, range=0..100)
crv = Curve(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)
series = Series(Start=margin_from_center, Step=dist_b_section_crvs, Count=num_of_section_crvs)
brec = BoundingRectangle(Geometry=crv, Plane=PlaneXY(0, 0, 0), Axis=0, Slide=0, Union=True)  # -> Bounding, DimensionX, DimensionY
Z = UnitZ(Factor=series)
move = Move(Geometry=crv, Motion=Z)  # -> Geometry, Transform
ccx = CurveCurve(CurveA=brec.Bounding, CurveB=crv)  # -> Points, ParamsA, ParamsB
x_minus_one = XMinusOne(NumberX=num_of_section_crvs)
pt = Point(ccx.Points)
range = Range(Domain=Domain(0, 1), Steps=x_minus_one)
X = UnitX(Factor=camber_symmetry)
item = ListItem(List=pt, Index=Slider(3, range=0..10), Wrap=True)
graph = GraphMapper(
    range,
    x0=0,
    x1=1,
    y0=0,
    y1=1,
    container_name="Bezier",
    cpx=[0, 0.5950756669, 1, 1],
    cpy=[0.7869140506, 0.832328558, 0.6801487207, 0.2267491221])
graph_2 = GraphMapper(
    range,
    x0=0,
    x1=1,
    y0=0,
    y1=1,
    container_name="Bezier",
    cpx=[0, 0.5, 0.4705114961, 1],
    cpy=[0.2895653844, 1, 0.2393042445, 0.2008693814])
graph_3 = GraphMapper(
    range,
    x0=0,
    x1=1,
    y0=0,
    y1=1,
    container_name="Bezier",
    cpx=[0, 0.7396735549, 0.3729783297, 1],
    cpy=[0, 0.6456825137, 0.4178329706, 1])
move_2 = Move(Geometry=item, Motion=X)  # -> Geometry, Transform
multiplication = Multiplication(A=graph_2, B=scale_x_mult)
multiplication_2 = Multiplication(A=graph, B=scale_y_mult)
scale_nu = ScaleNU(Geometry=move.Geometry, Plane=move_2.Geometry, ScaleX=multiplication, ScaleY=multiplication_2, ScaleZ=1)  # -> Geometry, Transform
item_2 = ListItem(List=scale_nu.Geometry, Index=-1, Wrap=True)
brec_2 = BoundingRectangle(Geometry=item_2, Plane=PlaneXY(0, 0, 0), Axis=0, Slide=0, Union=True)  # -> Bounding, DimensionX, DimensionY
dom = ConstructDomain(DomainStart=0, DomainEnd=blade_twist)
ccx_2 = CurveCurve(CurveA=item_2, CurveB=brec_2.Bounding)  # -> Points, ParamsA, ParamsB
remap = RemapNumbers(Value=graph_3, Source=Domain(0, 1), Target=dom)  # -> Mapped, Clipped
item_3 = ListItem(List=ccx_2.Points, Index=Slider(3, range=0..10), Wrap=True)
xz = XZPlane(Origin=item_3)
neg = Negative(Value=leading_edge_length)
lng = ListLength(List=scale_nu.Geometry)
rotate = Rotate(Geometry=item_2, Angle=degrees(neg), Plane=xz)  # -> Geometry, Transform
neg_2 = Negative(Value=cylinder_length)
replace = ReplaceItems(List=scale_nu.Geometry, Item=rotate.Geometry, Indices=expr("x-1", lng), Wrap=False)
area = Area(Geometry=replace)  # -> Area, Centroid
rotate_2 = Rotate(Geometry=replace, Angle=degrees(blade_angle), Plane=area.Centroid)  # -> Geometry, Transform
crv_2 = Curve(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)
rotate_3 = Rotate(Geometry=rotate_2.Geometry, Angle=degrees(remap.Mapped), Plane=PlaneXY(0, 0, 0))  # -> Geometry, Transform
area_2 = Area(Geometry=crv_2)  # -> Area, Centroid
item_4 = ListItem(List=scale_nu.Geometry, Index=0, Wrap=True)
Y = UnitY(Factor=expr("x*2", [neg_2, cylinder_length]))
loft = Loft(
    Curves=rotate_3.Geometry,
    Options={Adjust=False, Closed=False, LoftEnds=0, LoftSimp=0, LoftType=0, Rebuild=10, Refit=0.01})
area_3 = Area(Geometry=item_4)  # -> Area, Centroid
xz_2 = XZPlane(Origin=area_3.Centroid)
deplane = DeconstructPlane(Plane=xz_2)  # -> Origin, XAxis, YAxis, ZAxis
pdecon = Deconstruct(Point=deplane.Origin)  # -> XComponent, YComponent, ZComponent
pt_2 = ConstructPoint(XCoordinate=pdecon.XComponent, YCoordinate=expr("x-1", pdecon.YComponent), ZCoordinate=pdecon.ZComponent)
pl = ConstructPlane(Origin=pt_2, XAxis=deplane.XAxis, YAxis=deplane.YAxis)
move2pt = MoveToPoint(Geometry=crv_2, PointA=area_2.Centroid, PointB=xz_2)  # -> Moved, Vector, Transform
neg_3 = Negative(Value=cylinder_radius)
cyl = Cylinder(Base=xz_2, Radius=cylinder_radius, Length=[cylinder_length, neg_2])
cyl_2 = Cylinder(Base=pl, Radius=Slider(5, range=0..100), Length=Slider(12, range=0..100))
cap = CapHoles(Brep=loft)
extr = Extrude(Base=move2pt.Moved, Direction=Y)
Y_2 = UnitY(Factor=cylinder_length)
join = BrepJoin(Breps=cyl)  # -> Breps, Closed
cyl_3 = Cylinder(Base=deplane.Origin, Radius=Slider(1, range=0..1), Length=flatten([cylinder_radius, neg_3]))
cap_2 = CapHoles(Brep=cyl_2)
arrpolar = PolarArray(Geometry=cap, Plane=xz_2, Count=num_of_blades, Angle=6.283185307)  # -> Geometry, Transform
join_2 = BrepJoin(Breps=extr)  # -> Breps, Closed
neg_4 = Negative(Value=Y_2)
cap_3 = CapHoles(Brep=join.Breps)
join_3 = BrepJoin(Breps=cyl_3)  # -> Breps, Closed
preview = CustomPreview(
    Geometry=arrpolar.Geometry,
    Material={diffuse=RGB(221, 160, 221), emission=RGB(66, 48, 66), shine=0.5, specular=RGB(255, 255, 255), transparency=0})
dam = DataDam(DataA=arrpolar.Geometry, BufferDelay=10000000, BufferMode=0)
sunion = SolidUnion(Breps=cap_2)
cap_4 = CapHoles(Brep=join_2.Breps)
cap_5 = CapHoles(Brep=join_3.Breps)
sunion_2 = SolidUnion(Breps=flatten([cap_3, arrpolar.Geometry]))
sdiff = SolidDifference(BrepsA=sunion_2, BrepsB=cap_4)
move_3 = Move(Geometry=cap_5, Motion=neg_4)  # -> Geometry, Transform
sdiff_2 = SolidDifference(BrepsA=sdiff, BrepsB=sunion)
sdiff_3 = SolidDifference(BrepsA=sdiff_2, BrepsB=move_3.Geometry)
preview_2 = CustomPreview(Geometry=sdiff_3, Material=ColourSwatch(SwatchColor=RGB(170, 45, 252)))
